# Grasshopper definition HVACSystemWorkflow.gh (Grasshopper 1.0.7)
# plug-ins: Ironbug.Grasshopper

objparams = Ironbug_ObjParams(
    RatedCoolingCoefficientofPerformance="6.45",
    DataFieldSetType="Ironbug.HVAC.IB_CoilCoolingWaterToAirHeatPumpEquationFit_FieldSet")
objparams_2 = Ironbug_ObjParams(
    RatedHeatingCoefficientofPerformance="4",
    DataFieldSetType="Ironbug.HVAC.IB_CoilHeatingWaterToAirHeatPumpEquationFit_FieldSet")
brep = Brep()
objparams_3 = Ironbug_ObjParams(FanEfficiency="0.75", MotorEfficiency="0.9", PressureRise="430", DataFieldSetType="Ironbug.HVAC.IB_FanOnOff_FieldSet")
brep_2 = Brep([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])
objparams_4 = Ironbug_ObjParams(
    OutdoorAirFlowRateDuringCoolingOperation="0",
    OutdoorAirFlowRateDuringHeatingOperation="0",
    OutdoorAirFlowRateWhenNoCoolingorHeatingisNeeded="0",
    SupplyAirFlowRateWhenNoCoolingorHeatingisNeeded="0",
    DataFieldSetType="Ironbug.HVAC.IB_ZoneHVACWaterToAirHeatPump_FieldSet")
honeybee = Honeybee_Honeybee()  # -> Vviiiiiiiiiizzz; plug-in component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
ladybug = Ladybug_Ladybug()  # -> Vviiiiiiiiiizzz; plug-in component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
coilhtn_watertoair = Ironbug_CoilCoolingWaterToAirHeatPumpEquationFit(Parameters_=objparams)  # -> CoilCoolingWaterToAirHeatPumpEquationFit, ToWaterLoop
intersectmass = IntersectMass(x=brep_2)  # -> out, A; inputs x: list of Brep
# ---------- intersectmass: C# ----------
    var tolerance = Rhino.RhinoDoc.ActiveDoc.ModelAbsoluteTolerance;
    List<Brep> allOldBreps = x;

    if (x.Count() > 0)
    {
      var results = allOldBreps.AsParallel().AsOrdered().Select(b => SplitBrepWithBreps(b, allOldBreps, tolerance));
      A = results;
    }

    //SplitBrepWithBreps(x[0], x, tolerance);
# ---------- intersectmass: C# additional code ----------
  static Brep SplitBrepWithBreps(Brep CurrentBrep, List<Brep> AllBreps, double tolerance)
  {
    var currentBrep = CurrentBrep;
    var allBreps = AllBreps;

    foreach (Brep item in allBreps)
    {
      var  tempBrep = currentBrep.Split(item, tolerance);
      if (tempBrep.Count() > 0)
      {
        var newBrep = Rhino.Geometry.Brep.JoinBreps(tempBrep, tolerance);

        currentBrep = newBrep.First();
        currentBrep.Faces.ShrinkFaces();
      }
    }
    return currentBrep;

  }
# ---------- end intersectmass ----------
coilhtn_watertoair_2 = Ironbug_CoilHeatingWaterToAirHeatPumpEquationFit(Parameters_=objparams_2)  # -> CoilHeatingWaterToAirHeatPumpEquationFit, ToWaterLoop
number_slider = Slider(0.7, range=0..1)
fanonoff = Ironbug_FanOnOff(Parameters_=objparams_3)
mass2zone = Honeybee_Masses2Zones(zoneMasses=flatten(intersectmass.A), maxRoofAngle=30, createHBZones=Toggle(True))  # -> readMe, HBZones; plug-in component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
panel = Panel("https://www.energyplus.net/weather-download/north_and_central_america_wmo_region_4/USA/NY/USA_NY_New.York-LaGuardia.AP.725030_TMY3/all")
glzparamlist = Honeybee_GlazingParametersList(northGlzParam=0, westGlzParam=0, southGlzParam=number_slider, eastGlzParam=number_slider)  # -> glzParamList; plug-in component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
vavnoreheat = Ironbug_AirTerminalSingleDuctVAVNoReheat()
panel_2 = Panel("DifferentialDryBulb")
solveadjc = Honeybee_SolveAdjacencies(HBZones=flatten(mass2zone.HBZones), removeCurrentAdjc=False, findAdjc=Toggle(True))  # -> readMe, HBZonesWADJ; plug-in component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
glazingcreator = Honeybee_GlazingBasedOnRatio(HBObjects=solveadjc.HBZonesWADJ, glzRatio=glzparamlist, runIt=Toggle(True))  # -> readMe, HBObjWGLZ; plug-in component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
data = Data(flatten(glazingcreator.HBObjWGLZ))
separatezonesbyfloor = Honeybee_SeparateZonesByFloor(HBZones=flatten(data))  # -> floorHeights, HBZones; plug-in component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
lng = ListLength(List=separatezonesbyfloor.HBZones)
duplicate = Ironbug_Duplicate(Reference=coilhtn_watertoair_2.CoilHeatingWaterToAirHeatPumpEquationFit, Amount=lng)  # -> Objects, graft(ToWaterLoop)
duplicate_2 = Ironbug_Duplicate(Reference=coilhtn_watertoair.CoilCoolingWaterToAirHeatPumpEquationFit, Amount=lng)  # -> Objects, graft(ToWaterLoop)
duplicate_3 = Ironbug_Duplicate(Reference=fanonoff, Amount=lng)  # -> Objects, graft(port)
waterairheatpump = Ironbug_ZoneHVACWaterToAirHeatPump(HeatingCoil=duplicate.Objects, CoolingCoil=duplicate_2.Objects, Fan_=duplicate_3.Objects, Parameters_=objparams_4)
duplicate_4 = Ironbug_Duplicate(Reference=vavnoreheat, Amount=lng)  # -> Objects, graft(port)
epw_stat = Ladybug_OpenEPWAndSTATWeatherFiles(weatherFileURL=panel)  # -> epwFile, statFile; plug-in component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
thermalzone = Ironbug_ThermalZone(
    HoneybeeZonesOrOsZones=separatezonesbyfloor.HBZones,
    AirTerminal_=duplicate_4.Objects,
    ZoneEquipment=waterairheatpump,
    IsAirTerminalPriorToZoneEquipments=True)
groundhxvertical = Ironbug_GroundHeatExchangerVertical()
f2c = Ladybug_F2C(F="70")  # -> C; plug-in component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
pipeadiabatic = Ironbug_PipeAdiabatic()
pipeadiabatic_2 = Ironbug_PipeAdiabatic()
oasystem = Ironbug_OutdoorAirSystem()
f2c_2 = Ladybug_F2C(F="70")  # -> C; plug-in component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
coilclndx1 = Ironbug_CoilCoolingDXSingleSpeed()
coilhtngas = Ironbug_CoilHeatingGas()
fanvariable = Ironbug_FanVariableVolume()
spm_scheduled = Ironbug_SetpointManagerScheduled(Temperature=f2c)
objparams_5 = Ironbug_ObjParams(TypeofLoadtoSizeOn="VentilationRequirement", DataFieldSetType="Ironbug.HVAC.IB_SizingSystem_FieldSet")
panel_3 = Panel("""DOAS 1
DOAS 2""")
pumpvariable = Ironbug_PumpVariableSpeed()
plantbranches = PlantBranches(Branch1=groundhxvertical, Branch=pipeadiabatic)
spm_scheduled_2 = Ironbug_SetpointManagerScheduled(Temperature=f2c_2)
objparams_6 = Ironbug_ObjParams(Name="Heat Pump Loop", DataFieldSetType="Ironbug.HVAC.IB_PlantLoop_FieldSet")
plantbranches_2 = PlantBranches(B1=duplicate.ToWaterLoop, B2=duplicate_2.ToWaterLoop, B3=pipeadiabatic_2)
hvactemplate = Ironbug_HVACTemplate()
objparams_7 = Ironbug_ObjParams(Name=panel_3, DataFieldSetType="Ironbug.HVAC.IB_AirLoopHVAC_FieldSet")  # -> graft(HVACObjParams)
airloopbranches = AirLoopBranches(Branch1=thermalzone)
sizingsystem = Ironbug_SizingSystem(Parameters_=objparams_5)
merge = Merge(Data1=oasystem, Data2=coilclndx1, Data3=coilhtngas, Data4=fanvariable, Data5=spm_scheduled)
hvacsystemslist = Honeybee_HVACSystemsList({"-1. Thermostat Only": -1, "0. Ideal Air Loads": 0, "1. PTAC | Residential": 1, "2. PTHP | Residential": 2, "3. Packaged Single Zone - AC": 3, "4. Packaged Single Zone - HP": 4, "5. Packaged VAV w/ Reheat": 5, "6. Packaged VAV w/ PFP Boxes": 6, "7. VAV w/ Reheat": 7, "8. VAV w/ PFP Boxes": 8, "9. Warm Air Furnace - Gas Fired": 9, "10.Warm Air Furnace - Electric": 10, "11.Fan Coil Units + DOAS": 11, "12.Active Chilled Beams + DOAS": 12, "13.Radiant Floors + DOAS": 13, "14.Custom Rad Surfaces + DOAS": 14, "15.Heated Surfaces + VAV Cooling": 15, "16.VRF + DOAS": 16, "17.WSHP + DOAS": 17}, selected="4. Packaged Single Zone - HP")
merge_2 = Merge(Data1=pumpvariable, Data2=plantbranches, Data3=spm_scheduled_2)
condenserwaterloop = Ironbug_CondenserWaterPlantLoop(Supply=merge_2, Demand=plantbranches_2, Parameters_=objparams_6)
airloop = Ironbug_AirLoopHVAC(Supply=merge, Demand=airloopbranches, SizingSystem=sizingsystem, Parameters_=objparams_7)
hvacsystem = Ironbug_HVACSystem(AirLoops=flatten(airloop), PlantLoops=flatten(condenserwaterloop))
hvacsystem_2 = Honeybee_AssignHVACSystem(HBZones=graft(glazingcreator.HBObjWGLZ), HVACSystems=hvacsystemslist)  # -> readMe, HBZones; plug-in component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
toggle = BooleanToggle(False)
toggle_2 = BooleanToggle(False)
exporttoopenstudio = Honeybee_ExportToOpenStudio(
    epwWeatherFile=epw_stat.epwFile,
    HBZones=flatten(glazingcreator.HBObjWGLZ),
    HVACSystem=flatten(hvacsystem),
    writeOSM=toggle,
    openOpenStudio=toggle,
    fileName="IB_Sys")  # -> readMe, osmFileAddress, idfFileAddress, resultFileAddress, eioFileAddress, rddFileAddress, htmlReport, studyFolder, model; plug-in component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
exporttoopenstudio_2 = Honeybee_ExportToOpenStudio(
    epwWeatherFile=epw_stat.epwFile,
    HBZones=flatten(hvacsystem_2.HBZones),
    writeOSM=toggle_2,
    runSimulation=toggle_2,
    fileName="HB_Sys")  # -> readMe, osmFileAddress, idfFileAddress, resultFileAddress, eioFileAddress, rddFileAddress, htmlReport, studyFolder, model; plug-in component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
readepresult = Honeybee_ReadEPResult(resultFileAddress=exporttoopenstudio_2.resultFileAddress)  # -> totalThermalLoad, thermalLoadBalance, cooling, heating, electricLight, electricEquip, fanElectric, pumpElectric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; plug-in component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
panel_4 = Panel(exporttoopenstudio_2.osmFileAddress)
c_script = CSharpScript(x=exporttoopenstudio.osmFileAddress, Reference="C:\openstudio-2.5.0\CSharp\openstudio\OpenStudio.dll")  # -> out, A; inputs x: String; disabled
# ---------- c_script: C# ----------
    if (!string.IsNullOrEmpty(x))
    {
      var p = new OpenStudio.Path(x);
      var m = OpenStudio.Model.load(p).get();
      var plantLps = m.getPlantLoops();
      foreach (OpenStudio.PlantLoop pl in plantLps)
      {
        
        var tp = pl.sizingPlant().loopType();
        Print(pl.nameString() + "_" + tp);
      }
    }
# ---------- end c_script ----------
readepresult_2 = Honeybee_ReadEPResult(resultFileAddress=exporttoopenstudio.resultFileAddress)  # -> totalThermalLoad, thermalLoadBalance, cooling, heating, electricLight, electricEquip, fanElectric, pumpElectric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; plug-in component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
panel_5 = Panel(exporttoopenstudio.osmFileAddress)
panel_6 = Panel(exporttoopenstudio_2.readMe)
strnum = Ladybug_SeparateData(inputList=flatten(readepresult.cooling))  # -> numbers, strings; plug-in component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
strnum_2 = Ladybug_SeparateData(inputList=flatten(readepresult.heating))  # -> numbers, strings; plug-in component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
strnum_3 = Ladybug_SeparateData(inputList=flatten(readepresult_2.cooling))  # -> numbers, strings; plug-in component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
strnum_4 = Ladybug_SeparateData(inputList=flatten(readepresult_2.heating))  # -> numbers, strings; plug-in component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
ma = MassAddition(Input=flatten(strnum.numbers))  # -> Result, PartialResults
ma_2 = MassAddition(Input=strnum_2.numbers)  # -> Result, PartialResults
ma_3 = MassAddition(Input=flatten(strnum_3.numbers))  # -> Result, PartialResults
ma_4 = MassAddition(Input=strnum_4.numbers)  # -> Result, PartialResults
panel_7 = Panel(ma_2.Result)
panel_8 = Panel(ma.Result)
panel_9 = Panel(ma_4.Result)
panel_10 = Panel(ma_3.Result)
